# Grasshopper definition Parametric Drawbot Toolchanger.gh (Grasshopper 1.0.7)
# plug-ins: MetaHopper, Machina

curve = Curve([<curve referenced from the Rhino model> x5])

# ----
# A simple program that traces a vertical line in space
number_slider = Slider(1.104, range=0..2.1)
scale = Scale(Geometry=curve, Center=Point(0, 0, 0), Factor=number_slider)  # -> Geometry, Transform
rotate = Rotate(Geometry=scale.Geometry, Angle=degrees(Slider(0, range=0..360)), Plane=PlaneXY(0, 0, 0))  # -> Geometry, Transform
vector_xyz = VectorXYZ(XComponent=Slider(-234, range=-600..600), YComponent=Slider(485, range=-210..1500), ZComponent=0)  # -> Vector, Length
move = Move(Geometry=rotate.Geometry, Motion=vector_xyz.Vector)  # -> Geometry, Transform

point = Point(<point referenced from the Rhino model>)
point_2 = Point(<point referenced from the Rhino model>)
point_3 = Point(<point referenced from the Rhino model>)
unit_z = UnitZ(Factor=Slider(-0.18, range=-10..10))
move_2 = Move(Geometry=point, Motion=unit_z)  # -> Geometry, Transform
unit_z_2 = UnitZ(Factor=Slider(-0.12, range=-10..10))
move_3 = Move(Geometry=point_2, Motion=unit_z_2)  # -> Geometry, Transform
unit_z_3 = UnitZ(Factor=Slider(-0.27, range=-10..10))
move_4 = Move(Geometry=point_3, Motion=unit_z_3)  # -> Geometry, Transform
base_drawring_cplane = Plane3Pt(PointA=move_2.Geometry, PointB=move_3.Geometry, PointC=move_4.Geometry)

xy_plane = XYPlane(Origin=Point(0, 0, 0))
orient = Orient(Geometry=move.Geometry, Source=xy_plane, Target=base_drawring_cplane)  # -> Geometry, Transform
geometry = Geometry(flatten(orient.Geometry))

# ---- group: RGB Slider Limit
get_selected_objects = GetSelectedObjects(AllObjects_Object=[number_slider_23, number_slider_22, number_slider_25, number_slider_24, custom_preview_2, number_slider_27, number_slider_26, number_slider_28, number_slider_29, number_slider_31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])  # -> ComponentObjects, ParamObjects, OtherObjects
list_length = ListLength(List=geometry)
subtraction = Subtraction(A=list_length, B="1")
construct_domain = ConstructDomain(DomainStart="0", DomainEnd=subtraction)
set_slider_properties = SetSliderProperties(Slider=get_selected_objects.ParamObjects, Range=construct_domain)

# ---- group: RGB
number_slider_2 = Slider(1, range=0..4)
number_slider_3 = Slider(0, range=0..4)  # disabled
number_slider_4 = Slider(0, range=0..4)  # disabled
number_slider_5 = Slider(0, range=0..4)  # disabled
number_slider_6 = Slider(0, range=0..4)  # disabled
number_slider_7 = Slider(0, range=0..4)  # disabled
number_slider_8 = Slider(0, range=0..4)  # disabled
number_slider_9 = Slider(0, range=0..4)  # disabled
number_slider_10 = Slider(0, range=0..4)  # disabled
number_slider_11 = Slider(0, range=0..4)  # disabled
integer = Integer([number_slider_3, number_slider_2, number_slider_4, number_slider_5, number_slider_6, number_slider_7, number_slider_8, number_slider_9, number_slider_10, number_slider_11])
list_item = ListItem(List=geometry, Index=integer, Wrap=True)
curve_2 = Curve(list_item)
custom_preview = CustomPreview(Geometry=curve_2, Material=ColourSwatch(SwatchColor=RGB(0, 255, 102)))

number_slider_12 = Slider(2, range=0..4)
number_slider_13 = Slider(0, range=0..4)  # disabled
number_slider_14 = Slider(0, range=0..4)  # disabled
number_slider_15 = Slider(0, range=0..4)  # disabled
number_slider_16 = Slider(0, range=0..4)  # disabled
number_slider_17 = Slider(0, range=0..4)  # disabled
number_slider_18 = Slider(0, range=0..4)  # disabled
number_slider_19 = Slider(0, range=0..4)  # disabled
number_slider_20 = Slider(0, range=0..4)  # disabled
number_slider_21 = Slider(0, range=0..4)  # disabled
integer_2 = Integer([number_slider_12, number_slider_14, number_slider_13, number_slider_15, number_slider_16, number_slider_17, number_slider_18, number_slider_19, number_slider_20, number_slider_21])
list_item_2 = ListItem(List=geometry, Index=integer_2, Wrap=True)
curve_3 = Curve(list_item_2)
custom_preview_2 = CustomPreview(Geometry=curve_3, Material=ColourSwatch(SwatchColor=RGB(0, 30, 255)))

number_slider_22 = Slider(3, range=0..4)
number_slider_23 = Slider(0, range=0..4)
number_slider_24 = Slider(0, range=0..4)  # disabled
number_slider_25 = Slider(0, range=0..4)  # disabled
number_slider_26 = Slider(0, range=0..4)  # disabled
number_slider_27 = Slider(0, range=0..4)  # disabled
number_slider_28 = Slider(0, range=0..4)  # disabled
number_slider_29 = Slider(0, range=0..4)  # disabled
number_slider_30 = Slider(0, range=0..4)  # disabled
number_slider_31 = Slider(0, range=0..4)  # disabled
integer_3 = Integer([number_slider_22, number_slider_23, number_slider_24, number_slider_25, number_slider_26, number_slider_27, number_slider_28, number_slider_29, number_slider_30, number_slider_31])
list_item_3 = ListItem(List=geometry, Index=integer_3, Wrap=True)
curve_4 = Curve(list_item_3)
custom_preview_3 = CustomPreview(Geometry=curve_4, Material=ColourSwatch(SwatchColor=RGB(255, 0, 0)))

cull_index = CullIndex(List=geometry, Indices=[integer_3, integer, integer_2], Wrap=True)
curve_5 = Curve(cull_index)
custom_preview_4 = CustomPreview(Geometry=curve_5, Material=ColourSwatch(SwatchColor=RGB(0, 0, 0)))

# ---- group: Enable/Disable Sliders
enable_disable_object = EnableDisableObject(
    Enabled=Toggle(False),
    AllObjects_Object=[number_slider_23, number_slider_22, number_slider_25, number_slider_24, number_slider_27, number_slider_26, number_slider_28, number_slider_29, number_slider_31, number_slider_30, number_slider_2, number_slider_3, number_slider_5, number_slider_4, number_slider_7, number_slider_6, number_slider_8, number_slider_9, number_slider_11, number_slider_10, number_slider_12, number_slider_14, number_slider_15, number_slider_13, number_slider_17, number_slider_16, number_slider_18, number_slider_19, number_slider_21, number_slider_20])

# ---- group: Enable/Disable Curve Input
enable_disable_object_2 = EnableDisableObject(Enabled=Toggle(True), AllObjects_Object=drawbot_tool_changer)

# ---- group: XYZ
rz = Slider(-5.51, range=-9..9)
gz = Slider(-5.34, range=-9..9)
bz = Slider(-5.34, range=-9..9)
blackz = Slider(-5.69, range=-9..9)
Y = Slider(0, range=-1000..1000)
X = Slider(0, range=-1000..1000)

# ---- group: DCC
points_on_curve = Slider(2, range=0..12)

# ---- group: Relative Values
number_slider_32 = Slider(0, range=0..3)
number_slider_33 = Slider(200, range=0..200)
number_slider_34 = Slider(900, range=0..900)

# ---- group: Z Hop
distance_mm = Slider(30, range=0..100)

# ---- group: Absolute Values
number_slider_35 = Slider(100, range=0..300)
number_slider_36 = Slider(15, range=0..100)
number_slider_37 = Slider(0, range=0..3)

# ----
# "...to refer just to the scope and to the consistency of complex numbers does not do justice to this system. There is something more which, in my view, can only be described as 'magic'...
# 
# ...Over the four centuries that complex numbers have been known, a great many magical qualities have been gradually revealed.
# 
# 	Yet this is a magic that had been percieved to lie within mathematics, and it indeed provided a utility and a depth of mathematical insight that could not be achieved by use of the reals alone. There had not been any reason to expect that the physical world should be concerned with it.
# 
# 	And for some 350 years from the time that these numbers were introduced through the works of Cardano and Bombelli, it was purely through their mathematical role that the magic of the complex number system was percieved.
# 
# 	It would, no doubt, have come as a great surprise to all those who had voiced their suspicion of complex numbers to find that, according to the physics of the latter three quarters of the 20th century, the laws governing the behaviour of the world, at its tiniest scales, is fundamentally governed by the complex number system."
# 
# from 'The Road to Reality' by Roger Penrose
curve_6 = Curve(geometry)
drawbot_tool_changer = DrawbotToolChanger(
    absolute_speed=number_slider_35,
    absolute_acceleration=number_slider_36,
    absolute_precision=number_slider_37,
    relative_speed=number_slider_34,
    relative_acceleration=number_slider_33,
    relative_precision=number_slider_32,
    red_curves=integer_3,
    green_curves=integer,
    blue_curves=integer_2,
    black=curve_5,
    curve=curve_6,
    z_hop_distance=distance_mm,
    move_x=X,
    move_y=Y,
    red_z=rz,
    green_z=gz,
    blue_z=bz,
    black_z=blackz,
    divide_curve_count=points_on_curve)  # -> total_curve_count, full_spectrum_2, only_red_2, only_green_2, only_blue_2, only_black_2
panel = Panel(drawbot_tool_changer.total_curve_count)

# ---- group: End Position
axesto = AxesTo(A1="90", A2="-90", A3="90", A4="-90", A5="-90", A6="0", Relative=False)

# ---- group: Wait
wait = Wait(Time="3000")

# ----
data = Data(flatten(drawbot_tool_changer.only_black_2))
merge = Merge(Data1=axesto, Data2=wait, Data3=data, Data4=axesto)  # -> flatten(Result)

# ---- group: Concatenate all Actions into a Program
displayprogram = DisplayProgram(Actions=merge)
panel_2 = Panel(displayprogram)

# ---- group: Stream Program To Machina Bridge
send_program_to_bridge = Button()
connect_to_bridge = BooleanToggle(True)
connect = Connect(URL="ws://127.0.0.1:6999/Bridge", Name="Grasshopper", Connect=connect_to_bridge)  # -> Status, Bridge
send = Send(Bridge=connect.Bridge, Actions=merge, Send=send_program_to_bridge)  # -> Sent, Instructions
panel_3 = Panel(send.Instructions)
panel_4 = Panel(send.Sent)
panel_5 = Panel(connect.Status)

# ==== cluster DrawbotToolChanger

# ---- group: I/O / Absolute Values
absolute_acceleration = ClusterInput()
absolute_precision = ClusterInput()
absolute_speed = ClusterInput()

# ---- group: I/O / Relative Values
relative_acceleration = ClusterInput()
relative_precision = ClusterInput()
relative_speed = ClusterInput()

# ----
green_z = ClusterInput()
black_z = ClusterInput()
red_z = ClusterInput()

# ---- group: I/O / RGB
blue_curves = ClusterInput()
red_curves = ClusterInput()
green_curves = ClusterInput()

# ----
blue_z = ClusterInput()

# ---- group: Blue Actions / Wait
wait = Wait(Time="600")

wait_2 = Wait(Time="600")

# ---- group: Blue Actions / Relative Actions
number_slider = Slider(200, range=0..200)
number_slider_2 = Slider(1, range=0..3)
number_slider_3 = Slider(900, range=0..900)
acceleration = Acceleration(AccelerationInc=relative_acceleration, Relative=True)
speed = Speed(SpeedInc=relative_speed, Relative=True)
precision = Precision(RadiusInc=relative_precision, Relative=True)

# ---- group: Blue Actions / Absolute Values
number_slider_4 = Slider(15, range=0..100)
number_slider_5 = Slider(0, range=0..3)
number_slider_6 = Slider(100, range=0..300)
accelerationto = AccelerationTo(Acceleration=absolute_acceleration, Relative=False)
precisionto = PrecisionTo(Radius=absolute_precision, Relative=False)
speedto = SpeedTo(Speed=absolute_speed, Relative=False)

# ---- group: Blue Actions / Open Gripper
boolean_toggle = BooleanToggle(False)
writedigital = WriteDigital(DigitalPin="0", On=boolean_toggle, ToolPin=invert(boolean_toggle))
panel = Panel(writedigital)

# ---- group: Blue Actions / Close Gripper
boolean_toggle_2 = BooleanToggle(True)
writedigital_2 = WriteDigital(DigitalPin="0", On=boolean_toggle_2, ToolPin=boolean_toggle_2)
panel_2 = Panel(writedigital_2)

# ---- group: Blue Actions / Home
axesto = AxesTo(A1="90", A2="-90", A3="90", A4="-90", A5="-90", A6="0", Relative=False)

# ---- group: Blue Actions / BLUE DOWN
axesto_2 = AxesTo(A1="148.419", A2="-76.318", A3="103.448", A4="-117.187", A5="-90", A6="16.266", Relative=False)

# ---- group: Blue Actions / BLUE UP
axesto_3 = AxesTo(A1="148.419", A2="-79.71", A3="96.767", A4="-107.109", A5="-90", A6="16.249", Relative=False)

# ---- group: Blue Actions / Relative Actions
number_slider_7 = Slider(200, range=0..200)
number_slider_8 = Slider(1, range=0..3)
number_slider_9 = Slider(900, range=0..900)
acceleration_2 = Acceleration(AccelerationInc=relative_acceleration, Relative=True)
speed_2 = Speed(SpeedInc=relative_speed, Relative=True)
precision_2 = Precision(RadiusInc=relative_precision, Relative=True)

# ---- group: Blue Actions / Absolute Values
number_slider_10 = Slider(15, range=0..100)
number_slider_11 = Slider(0, range=0..3)
number_slider_12 = Slider(100, range=0..300)
accelerationto_2 = AccelerationTo(Acceleration=absolute_acceleration, Relative=False)
precisionto_2 = PrecisionTo(Radius=absolute_precision, Relative=False)
speedto_2 = SpeedTo(Speed=absolute_speed, Relative=False)

# ---- group: Blue Actions / Open Gripper
boolean_toggle_3 = BooleanToggle(False)
writedigital_3 = WriteDigital(DigitalPin="0", On=boolean_toggle_3, ToolPin=invert(boolean_toggle_3))
panel_3 = Panel(writedigital_3)

# ---- group: Blue Actions / Close Gripper
boolean_toggle_4 = BooleanToggle(True)
writedigital_4 = WriteDigital(DigitalPin="0", On=boolean_toggle_4, ToolPin=boolean_toggle_4)
panel_4 = Panel(writedigital_4)

# ---- group: Blue Actions / Home
axesto_4 = AxesTo(A1="90", A2="-90", A3="90", A4="-90", A5="-90", A6="0", Relative=False)

# ---- group: Blue Actions / BLUE DOWN
axesto_5 = AxesTo(A1="148.419", A2="-76.318", A3="103.448", A4="-117.187", A5="-90", A6="16.266", Relative=False)

# ---- group: Blue Actions / BLUE UP
axesto_6 = AxesTo(A1="148.419", A2="-79.71", A3="96.767", A4="-107.109", A5="-90", A6="16.249", Relative=False)

# ---- group: Relative Actions
number_slider_13 = Slider(200, range=0..200)
number_slider_14 = Slider(1, range=0..3)
number_slider_15 = Slider(900, range=0..900)
acceleration_3 = Acceleration(AccelerationInc=relative_acceleration, Relative=True)
speed_3 = Speed(SpeedInc=relative_speed, Relative=True)
precision_3 = Precision(RadiusInc=relative_precision, Relative=True)

# ---- group: Absolute Values
number_slider_16 = Slider(0, range=0..3)
number_slider_17 = Slider(15, range=0..100)
number_slider_18 = Slider(100, range=0..300)
accelerationto_3 = AccelerationTo(Acceleration=absolute_acceleration, Relative=False)
precisionto_3 = PrecisionTo(Radius=absolute_precision, Relative=False)
speedto_3 = SpeedTo(Speed=absolute_speed, Relative=False)

# ---- group: Home
axesto_7 = AxesTo(A1="90", A2="-90", A3="90", A4="-90", A5="-90", A6="0", Relative=False)

# ---- group: Open Gripper
boolean_toggle_5 = BooleanToggle(False)
writedigital_5 = WriteDigital(DigitalPin="0", On=boolean_toggle_5, ToolPin=invert(boolean_toggle_5))
panel_5 = Panel(writedigital_5)

# ---- group: Close Gripper
boolean_toggle_6 = BooleanToggle(True)
writedigital_6 = WriteDigital(DigitalPin="0", On=boolean_toggle_6, ToolPin=boolean_toggle_6)
panel_6 = Panel(writedigital_6)

# ---- group: Wait
wait_3 = Wait(Time="600")

# ---- group: Relative Actions
number_slider_19 = Slider(200, range=0..200)
number_slider_20 = Slider(1, range=0..3)
number_slider_21 = Slider(900, range=0..900)
acceleration_4 = Acceleration(AccelerationInc=relative_acceleration, Relative=True)
speed_4 = Speed(SpeedInc=relative_speed, Relative=True)
precision_4 = Precision(RadiusInc=relative_precision, Relative=True)

# ----
number_slider_22 = Slider(0, range=0..3)
number_slider_23 = Slider(15, range=0..100)
number_slider_24 = Slider(100, range=0..300)
accelerationto_4 = AccelerationTo(Acceleration=absolute_acceleration, Relative=False)
precisionto_4 = PrecisionTo(Radius=absolute_precision, Relative=False)
speedto_4 = SpeedTo(Speed=absolute_speed, Relative=False)

# ---- group: Home
axesto_8 = AxesTo(A1="90", A2="-90", A3="90", A4="-90", A5="-90", A6="0", Relative=False)

# ----
wait_4 = Wait(Time="600")

# ---- group: Close Gripper
boolean_toggle_7 = BooleanToggle(True)
writedigital_7 = WriteDigital(DigitalPin="0", On=boolean_toggle_7, ToolPin=boolean_toggle_7)
panel_7 = Panel(writedigital_7)

# ---- group: Open Gripper
boolean_toggle_8 = BooleanToggle(False)
writedigital_8 = WriteDigital(DigitalPin="0", On=boolean_toggle_8, ToolPin=invert(boolean_toggle_8))
panel_8 = Panel(writedigital_8)

# ---- group: Black Coordinates / BLACK UP
axesto_9 = AxesTo(A1="128.577", A2="-65.185", A3="74.444", A4="-99.305", A5="-90", A6="-8.846", Relative=False)

# ---- group: Black Coordinates / BLACK IN/OUT
axesto_10 = AxesTo(A1="123.438", A2="-73.367", A3="85.995", A4="-102.663", A5="-90", A6="-13.957", Relative=False)

# ---- group: Black Coordinates / BLACK DOWN
axesto_11 = AxesTo(A1="128.572", A2="-62.67", A3="82.271", A4="-109.647", A5="-90", A6="-8.852", Relative=False)

# ---- group: Blue Coordinates / BLUE UP
axesto_12 = AxesTo(A1="140.965", A2="-78.134", A3="91.943", A4="-103.814", A5="-89.994", A6="5.655", Relative=False)

# ---- group: Blue Coordinates / BLUE DOWN
axesto_13 = AxesTo(A1="140.965", A2="-74.84", A3="99.677", A4="-114.844", A5="-89.954", A6="5.655", Relative=False)

# ---- group: Blue Coordinates / BLUE IN/OUT
axesto_14 = AxesTo(A1="135.986", A2="-87.64", A3="102.806", A4="-105.172", A5="-89.937", A6="0.699", Relative=False)

# ---- group: Red Coordinates / RED UP
axesto_15 = AxesTo(A1="132.073", A2="-70.961", A3="82.563", A4="-101.62", A5="-90", A6="-3.243", Relative=False)

# ---- group: Red Coordinates / RED DOWN
axesto_16 = AxesTo(A1="132.073", A2="-68.079", A3="90.252", A4="-112.189", A5="-90", A6="-3.237", Relative=False)

# ---- group: Red Coordinates / RED IN/OUT
axesto_17 = AxesTo(A1="126.813", A2="-79.464", A3="93.61", A4="-104.152", A5="-90", A6="-8.468", Relative=False)

# ---- group: Green Coordinates / GREEN DOWN
axesto_18 = AxesTo(A1="136.106", A2="-71.408", A3="94.939", A4="-113.537", A5="-89.983", A6="0.796", Relative=False)

# ---- group: Green Coordinates / GREEN IN/OUT
axesto_19 = AxesTo(A1="130.932", A2="-83.468", A3="98.216", A4="-104.771", A5="-89.972", A6="-4.354", Relative=False)

# ---- group: Green Coordinates / GREEN UP
axesto_20 = AxesTo(A1="136.106", A2="-74.496", A3="87.25", A4="-102.766", A5="-90", A6="0.791", Relative=False)

# ---- group: Open Gripper
boolean_toggle_9 = BooleanToggle(False)  # disabled
panel_9 = Panel("0")  # disabled
writedigital_9 = WriteDigital(DigitalPin=panel_9, On=boolean_toggle_9, ToolPin=invert(boolean_toggle_9))  # disabled
panel_10 = Panel(writedigital_9)  # disabled

# ---- group: Close Gripper
boolean_toggle_10 = BooleanToggle(True)  # disabled
panel_11 = Panel("0")  # disabled
writedigital_10 = WriteDigital(DigitalPin=panel_11, On=boolean_toggle_10, ToolPin=boolean_toggle_10)  # disabled
panel_12 = Panel(writedigital_10)  # disabled

# ---- group: Home
panel_13 = Panel("90")  # disabled
panel_14 = Panel("-90")  # disabled
panel_15 = Panel("0")  # disabled
axesto_21 = AxesTo(A1=panel_13, A2=panel_14, A3=panel_13, A4=panel_14, A5=panel_14, A6=panel_15, Relative=False)  # disabled

# ---- group: Wait
panel_16 = Panel("600")  # disabled
wait_5 = Wait(Time=panel_16)  # disabled

# ---- group: Absolute Values
accelerationto_5 = AccelerationTo(Acceleration=absolute_acceleration, Relative=False)
precisionto_5 = PrecisionTo(Radius=absolute_precision, Relative=False)
speedto_5 = SpeedTo(Speed=absolute_speed, Relative=False)

# ---- group: I/O
z_hop_distance = ClusterInput()
curve = ClusterInput()
black = ClusterInput()
move_x = ClusterInput()
move_y = ClusterInput()
divide_curve_count = ClusterInput()

# ----
curve_2 = Curve(flatten(curve))

# ---- group: Total List Length
panel_17 = Panel(curve_2)
list_length = ListLength(List=panel_17)
subtraction = Subtraction(A=list_length, B="0")

# ---- group: Blue Actions / Z Hop
number_slider_25 = Slider(12, range=0..100)
unit_z = UnitZ(Factor=z_hop_distance)
move = Move(Vector=unit_z, Relative=True)

number_slider_26 = Slider(12, range=0..100)
unit_z_2 = UnitZ(Factor=z_hop_distance)
move_2 = Move(Vector=unit_z_2, Relative=True)

# ---- group: Z Hop
number_slider_27 = Slider(12, range=0..100)
unit_z_3 = UnitZ(Factor=z_hop_distance)
move_3 = Move(Vector=unit_z_3, Relative=True)

number_slider_28 = Slider(12, range=0..100)
unit_z_4 = UnitZ(Factor=z_hop_distance)
move_4 = Move(Vector=unit_z_4, Relative=True)

# ---- group: I/O (continued)
total_curve_count = ClusterOutput(subtraction)

# ---- group: Blue Actions
list_item = ListItem(List=curve_2, Index=blue_curves, Wrap=True)
curve_3 = Curve(list_item)
custom_preview = CustomPreview(Geometry=curve_3, Material=ColourSwatch(SwatchColor=RGB(0, 17, 255)))
dcc = Integer(divide_curve_count)

# ---- group: Blue Actions / Divide Curves and assign them to XY Plane
curve_4 = Curve(list_item)

# ----
R = Slider(1, range=0..10)
list_item_2 = ListItem(List=curve_2, Index=red_curves, Wrap=True)
colour_swatch = ColourSwatch(SwatchColor=RGB(255, 0, 0))
curve_5 = Curve(list_item_2)
panel_18 = Panel(colour_swatch)
colour = Colour(colour_swatch)
custom_preview_2 = CustomPreview(Geometry=curve_5, Material=colour)

# ---- group: Divide Curves and assign them to XY Plane
curve_6 = Curve(list_item_2)

# ----
G = Slider(3, range=0..10)
list_item_3 = ListItem(List=curve_2, Index=green_curves, Wrap=True)
colour_swatch_2 = ColourSwatch(SwatchColor=RGB(0, 255, 94))
panel_19 = Panel(colour_swatch_2)
curve_7 = Curve(list_item_3)
colour_2 = Colour(panel_19)
custom_preview_3 = CustomPreview(Geometry=curve_7, Material=colour_swatch_2)

# ---- group: Divide Curves and assign them to XY Plane
curve_8 = Curve(list_item_3)

# ---- group: Blue Actions
curve_9 = Curve(flatten(black))
custom_preview_4 = CustomPreview(Geometry=curve_9, Material=ColourSwatch(SwatchColor=RGB(0, 0, 0)))
dcc_2 = Integer(divide_curve_count)

# ----
dcc_3 = Integer(divide_curve_count)

cull_index = CullIndex(List=curve_2, Indices=red_curves, Wrap=Toggle(True))

cull_index_2 = CullIndex(List=cull_index, Indices=green_curves, Wrap=Toggle(True))

# ---- group: Blue Actions (continued)
cull_index_3 = CullIndex(List=cull_index_2, Indices=graft(blue_curves), Wrap=Toggle(True))

Y = Slider(-517, range=-1000..1000)
Z = Slider(12, range=-1000..1000)
X = Slider(50, range=-1000..1000)
vector_xyz = VectorXYZ(XComponent=move_x, YComponent=move_y, ZComponent=black_z)  # -> Vector, Length
move_5 = Move(Geometry=curve_9, Motion=vector_xyz.Vector)  # -> Geometry, Transform
curve_to_polyline = CurveToPolyline(Curve=move_5.Geometry, ToleranceDistance=0, ToleranceAngle=0, MaxEdge=Slider(0.3, range=0..2))  # -> Polyline, Segments

# ----
divide_length = DivideLength(Curve=curve_to_polyline.Polyline, Length=divide_curve_count)  # -> Points, Tangents, Parameters

# ---- group: Blue Actions (continued)
xy_plane = XYPlane(Origin=divide_length.Points)

# ---- group: Blue Actions / Transform to base plane to match robot's TCP orientation
deconstruct_plane = DeconstructPlane(Plane=xy_plane)  # -> Origin, XAxis, YAxis, ZAxis
rotate_3d = Rotate3D(Geometry=xy_plane, Angle=degrees("0"), Center=deconstruct_plane.Origin, Axis=deconstruct_plane.YAxis)  # -> Geometry, Transform
transformto = TransformTo(Plane=rotate_3d.Geometry, Relative=False)

# ---- group: Blue Actions / Close To Point 0
list_item_4 = ListItem(List=transformto, Index=dcc_2, Wrap=True)
panel_20 = Panel(list_item_4)
insert_items = InsertItems(List=transformto, Item=list_item_4, Indices=dcc_2, Wrap=True)

# ---- group: Blue Actions / Close To Point 1
addition = Addition(A=dcc_2, B="1")
list_item_5 = ListItem(List=transformto, Index=dcc_2, Wrap=True)
panel_21 = Panel(list_item_5)
insert_items_2 = InsertItems(List=insert_items, Item=list_item_5, Indices=addition, Wrap=True)

# ---- group: Blue Actions / Close To Point 2
addition_2 = Addition(A=dcc_2, B="2")
list_item_6 = ListItem(List=transformto, Index=dcc_2, Wrap=True)
panel_22 = Panel(list_item_6)
insert_items_3 = InsertItems(List=insert_items_2, Item=list_item_6, Indices=addition_2, Wrap=True)

# ---- group: Blue Actions / Combine curves with Z Hop every "*" points
addition_3 = Addition(A=dcc_2, B="4")
insert_items_4 = InsertItems(List=insert_items_3, Item=move, Indices=addition_3, Wrap=True)  # -> flatten(List)

# ---- group: Blue Actions
blue_in = Merge(
    Data1=writedigital,
    Data2=axesto_10,
    Data3=axesto_9,
    Data4=axesto_11,
    Data5=wait,
    Data6=writedigital_2,
    Data7=wait,
    Data8=axesto_9,
    Data9=axesto_10,
    Data10=axesto)
action = Merge(Data1=insert_items_4)
blue_out = Merge(Data1=axesto, Data2=axesto_10, Data3=axesto_9, Data4=axesto_11, Data5=writedigital, Data6=axesto_9, Data7=axesto_10)
set_motion_to_relative = Merge(Data1=speed, Data2=acceleration, Data3=precision)
set_motion_to_absolute = Merge(Data1=speedto, Data2=accelerationto, Data3=precisionto)

panel_23 = Panel(insert_items_4)
panel_24 = Panel(blue_out)
merge = Merge(
    Data1=flatten(set_motion_to_absolute),
    Data2=flatten(blue_in),
    Data3=flatten(set_motion_to_relative),
    Data4=flatten(action),
    Data5=flatten(set_motion_to_absolute),
    Data6=flatten(blue_out),
    Data7=flatten(set_motion_to_relative))  # -> flatten(Result)
panel_25 = Panel(merge)

X_2 = Slider(50, range=-1000..1000)
Y_2 = Slider(-517, range=-1000..1000)
Z_2 = Slider(12, range=-1000..1000)
vector_xyz_2 = VectorXYZ(XComponent=move_x, YComponent=move_y, ZComponent=blue_z)  # -> Vector, Length
move_6 = Move(Geometry=curve_4, Motion=vector_xyz_2.Vector)  # -> Geometry, Transform
curve_to_polyline_2 = CurveToPolyline(Curve=move_6.Geometry, ToleranceDistance=0, ToleranceAngle=0, MaxEdge=Slider(0.3, range=0..2))  # -> Polyline, Segments

# ----
divide_length_2 = DivideLength(Curve=curve_to_polyline_2.Polyline, Length=divide_curve_count)  # -> Points, Tangents, Parameters

# ---- group: Blue Actions (continued)
xy_plane_2 = XYPlane(Origin=divide_length_2.Points)

# ---- group: Blue Actions / Transform to base plane to match robot's TCP orientation
deconstruct_plane_2 = DeconstructPlane(Plane=xy_plane_2)  # -> Origin, XAxis, YAxis, ZAxis
rotate_3d_2 = Rotate3D(Geometry=xy_plane_2, Angle=degrees("0"), Center=deconstruct_plane_2.Origin, Axis=deconstruct_plane_2.YAxis)  # -> Geometry, Transform
transformto_2 = TransformTo(Plane=rotate_3d_2.Geometry, Relative=False)

# ---- group: Blue Actions / Close To Point 0
list_item_7 = ListItem(List=transformto_2, Index=dcc, Wrap=True)
panel_26 = Panel(list_item_7)
insert_items_5 = InsertItems(List=transformto_2, Item=list_item_7, Indices=dcc, Wrap=True)

# ---- group: Blue Actions / Close To Point 1
addition_4 = Addition(A=dcc, B="1")
list_item_8 = ListItem(List=transformto_2, Index=dcc, Wrap=True)
panel_27 = Panel(list_item_8)
insert_items_6 = InsertItems(List=insert_items_5, Item=list_item_8, Indices=addition_4, Wrap=True)

# ---- group: Blue Actions / Close To Point 2
addition_5 = Addition(A=dcc, B="2")
list_item_9 = ListItem(List=transformto_2, Index=dcc, Wrap=True)
panel_28 = Panel(list_item_9)
insert_items_7 = InsertItems(List=insert_items_6, Item=list_item_9, Indices=addition_5, Wrap=True)

# ---- group: Blue Actions / Combine curves with Z Hop every "*" points
addition_6 = Addition(A=dcc, B="4")
insert_items_8 = InsertItems(List=insert_items_7, Item=move_2, Indices=addition_6, Wrap=True)  # -> flatten(List)

# ---- group: Blue Actions
blue_in_2 = Merge(
    Data1=writedigital_3,
    Data2=axesto_14,
    Data3=axesto_12,
    Data4=axesto_13,
    Data5=wait_2,
    Data6=writedigital_4,
    Data7=wait_2,
    Data8=axesto_12,
    Data9=axesto_14,
    Data10=axesto_4)
action_2 = Merge(Data1=insert_items_8)
blue_out_2 = Merge(
    Data1=axesto_4,
    Data2=axesto_14,
    Data3=axesto_12,
    Data4=axesto_13,
    Data5=writedigital_3,
    Data6=axesto_12,
    Data7=axesto_14)
set_motion_to_relative_2 = Merge(Data1=speed_2, Data2=acceleration_2, Data3=precision_2)
set_motion_to_absolute_2 = Merge(Data1=speedto_2, Data2=accelerationto_2, Data3=precisionto_2)

panel_29 = Panel(insert_items_8)
panel_30 = Panel(blue_out_2)
merge_2 = Merge(
    Data1=flatten(set_motion_to_absolute_2),
    Data2=flatten(blue_in_2),
    Data3=flatten(set_motion_to_relative_2),
    Data4=flatten(action_2),
    Data5=flatten(set_motion_to_absolute_2),
    Data6=flatten(blue_out_2),
    Data7=flatten(set_motion_to_relative_2))  # -> flatten(Result)
panel_31 = Panel(merge_2)

# ----
Z_3 = Slider(12, range=-1000..1000)
X_3 = Slider(50, range=-1000..1000)
Y_3 = Slider(-517, range=-1000..1000)
vector_xyz_3 = VectorXYZ(XComponent=move_x, YComponent=move_y, ZComponent=green_z)  # -> Vector, Length
move_7 = Move(Geometry=curve_8, Motion=vector_xyz_3.Vector)  # -> Geometry, Transform
curve_to_polyline_3 = CurveToPolyline(Curve=move_7.Geometry, ToleranceDistance=0, ToleranceAngle=0, MaxEdge=Slider(0.3, range=0..2))  # -> Polyline, Segments

divide_length_3 = DivideLength(Curve=curve_to_polyline_3.Polyline, Length=divide_curve_count)  # -> Points, Tangents, Parameters

xy_plane_3 = XYPlane(Origin=divide_length_3.Points)

# ---- group: Transform to base plane to match robot's TCP orientation
deconstruct_plane_3 = DeconstructPlane(Plane=xy_plane_3)  # -> Origin, XAxis, YAxis, ZAxis
rotate_3d_3 = Rotate3D(Geometry=xy_plane_3, Angle=degrees("0"), Center=deconstruct_plane_3.Origin, Axis=deconstruct_plane_3.YAxis)  # -> Geometry, Transform
transformto_3 = TransformTo(Plane=rotate_3d_3.Geometry, Relative=False)

# ----
X_4 = Slider(50, range=-1000..1000)
Z_4 = Slider(12, range=-1000..1000)
Y_4 = Slider(-517, range=-1000..1000)
vector_xyz_4 = VectorXYZ(XComponent=move_x, YComponent=move_y, ZComponent=red_z)  # -> Vector, Length
move_8 = Move(Geometry=curve_6, Motion=vector_xyz_4.Vector)  # -> Geometry, Transform
curve_to_polyline_4 = CurveToPolyline(Curve=move_8.Geometry, ToleranceDistance=0, ToleranceAngle=0, MaxEdge=Slider(0.3, range=0..2))  # -> Polyline, Segments

divide_length_4 = DivideLength(Curve=curve_to_polyline_4.Polyline, Length=divide_curve_count)  # -> Points, Tangents, Parameters

xy_plane_4 = XYPlane(Origin=divide_length_4.Points)

# ---- group: Transform to base plane to match robot's TCP orientation
deconstruct_plane_4 = DeconstructPlane(Plane=xy_plane_4)  # -> Origin, XAxis, YAxis, ZAxis
rotate_3d_4 = Rotate3D(Geometry=xy_plane_4, Angle=degrees("0"), Center=deconstruct_plane_4.Origin, Axis=deconstruct_plane_4.YAxis)  # -> Geometry, Transform
transformto_4 = TransformTo(Plane=rotate_3d_4.Geometry, Relative=False)

# ---- group: Close To Point 0
list_item_10 = ListItem(List=transformto_4, Index=dcc_3, Wrap=True)
panel_32 = Panel(list_item_10)
insert_items_9 = InsertItems(List=transformto_4, Item=list_item_10, Indices=dcc_3, Wrap=True)

# ----
addition_7 = Addition(A=dcc_3, B="1")
list_item_11 = ListItem(List=transformto_4, Index=dcc_3, Wrap=True)
panel_33 = Panel(list_item_11)
insert_items_10 = InsertItems(List=insert_items_9, Item=list_item_11, Indices=addition_7, Wrap=True)

addition_8 = Addition(A=dcc_3, B="2")
list_item_12 = ListItem(List=transformto_4, Index=dcc_3, Wrap=True)
panel_34 = Panel(list_item_12)
insert_items_11 = InsertItems(List=insert_items_10, Item=list_item_12, Indices=addition_8, Wrap=True)

# ---- group: Combine curves with Z Hop every "*" points
addition_9 = Addition(A=dcc_3, B="4")
insert_items_12 = InsertItems(List=insert_items_11, Item=move_4, Indices=addition_9, Wrap=True)  # -> flatten(List)

# ----
red_in = Merge(
    Data1=axesto_8,
    Data2=writedigital_8,
    Data3=axesto_17,
    Data4=axesto_15,
    Data5=axesto_16,
    Data6=wait_4,
    Data7=writedigital_7,
    Data8=wait_4,
    Data9=axesto_15,
    Data10=axesto_17,
    Data11=axesto_8)
set_motion_to_absolute_3 = Merge(Data1=speedto_4, Data2=accelerationto_4, Data3=precisionto_4)
set_motion_to_relative_3 = Merge(Data1=speed_4, Data2=acceleration_4, Data3=precision_4)
action_3 = Merge(Data1=insert_items_12)
red_out = Merge(Data1=axesto_8, Data2=axesto_17, Data3=axesto_15, Data4=axesto_16, Data5=writedigital_8, Data6=axesto_15)

panel_35 = Panel(insert_items_12)
merge_3 = Merge(
    Data1=flatten(set_motion_to_absolute_3),
    Data2=flatten(red_in),
    Data3=flatten(set_motion_to_relative_3),
    Data4=flatten(action_3),
    Data5=flatten(set_motion_to_absolute_3),
    Data6=flatten(red_out))  # -> flatten(Result)
panel_36 = Panel(merge_3)

dcc_4 = Integer(divide_curve_count)

# ---- group: Close To Point 0
list_item_13 = ListItem(List=transformto_3, Index=dcc_4, Wrap=True)
panel_37 = Panel(list_item_13)
insert_items_13 = InsertItems(List=transformto_3, Item=list_item_13, Indices=dcc_4, Wrap=True)

# ---- group: Close To Point 1
addition_10 = Addition(A=dcc_4, B="1")
list_item_14 = ListItem(List=transformto_3, Index=dcc_4, Wrap=True)
panel_38 = Panel(list_item_14)
insert_items_14 = InsertItems(List=insert_items_13, Item=list_item_14, Indices=addition_10, Wrap=True)

# ---- group: Close To Point 2
addition_11 = Addition(A=dcc_4, B="2")
list_item_15 = ListItem(List=transformto_3, Index=dcc_4, Wrap=True)
panel_39 = Panel(list_item_15)
insert_items_15 = InsertItems(List=insert_items_14, Item=list_item_15, Indices=addition_11, Wrap=True)

# ---- group: Combine curves with Z Hop every "*" points
addition_12 = Addition(A=dcc_4, B="4")
insert_items_16 = InsertItems(List=insert_items_15, Item=move_3, Indices=addition_12, Wrap=True)  # -> flatten(List)

# ----
panel_40 = Panel(insert_items_16)

action_4 = Merge(Data1=insert_items_16)
green_out = Merge(
    Data1=axesto_7,
    Data2=axesto_19,
    Data3=axesto_20,
    Data4=axesto_18,
    Data5=writedigital_5,
    Data6=axesto_20,
    Data7=axesto_19)
green_in = Merge(
    Data1=writedigital_5,
    Data2=axesto_19,
    Data3=axesto_20,
    Data4=axesto_18,
    Data5=wait_3,
    Data6=writedigital_6,
    Data7=wait_3,
    Data8=axesto_20,
    Data9=axesto_19,
    Data10=axesto_7)
set_motion_to_absolute_4 = Merge(Data1=speedto_3, Data2=accelerationto_3, Data3=precisionto_3)
set_motion_to_relative_4 = Merge(Data1=speed_3, Data2=acceleration_3, Data3=precision_3)

merge_4 = Merge(
    Data1=flatten(set_motion_to_absolute_4),
    Data2=flatten(green_in),
    Data3=flatten(set_motion_to_relative_4),
    Data4=flatten(action_4),
    Data5=flatten(set_motion_to_absolute_4),
    Data6=flatten(green_out))  # -> flatten(Result)
panel_41 = Panel(merge_4)

# ---- group: Final Merge
full_spectrum = Merge(Data1=merge_3, Data2=merge_4, Data3=merge_2, Data4=merge, Data5=speedto_5, Data6=accelerationto_5, Data7=precisionto_5)  # -> flatten(Result)
panel_42 = Panel(full_spectrum)
only_red = Merge(Data1=merge_3, Data2=speedto_5, Data3=accelerationto_5, Data4=precisionto_5)
only_blue = Merge(Data1=merge_2, Data2=speedto_5, Data3=accelerationto_5, Data4=precisionto_5)
only_green = Merge(Data1=merge_4, Data2=speedto_5, Data3=accelerationto_5, Data4=precisionto_5)
only_black = Merge(Data1=merge, Data2=speedto_5, Data3=accelerationto_5, Data4=precisionto_5)

# ---- group: I/O (continued)
only_black_2 = ClusterOutput(only_black)  # Executes only Black curves
only_blue_2 = ClusterOutput(only_blue)  # Executes only Blue curves
only_red_2 = ClusterOutput(only_red)  # Executes only Red curves
only_green_2 = ClusterOutput(only_green)  # Executes only Green curves
full_spectrum_2 = ClusterOutput(full_spectrum)  # Executes the full spectrum of colours
